# Grasshopper definition GeneratingPolyline.gh (Grasshopper 1.0.7)

# REFERENCE:
# 
# KOREAN
# C# Basic programming - https://computationaldesign.tistory.com/38
# Grasshopper C# Workshop Episode A - https://computationaldesign.tistory.com/14
# Grasshopper C# Workshop Episode B - https://computationaldesign.tistory.com/15
# Rhino Python - https://computationaldesign.tistory.com/21
# RhinoGrasshopperPython Challenge - https://computationaldesign.tistory.com/25
# Plugin / Addon / lib - https://computationaldesign.tistory.com/36
# Rhino3d & Ecosystem - https://computationaldesign.tistory.com/35
# 
# ENGLISH
# https://www.youtube.com/playlist?list=PLIyZNoxG7nmngv52XasDd0PTgqRFNauIm
geo = Geometry(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)
c_script = CSharpScript(pl=geo)  # -> out, A, B; inputs pl: Polyline
# ---------- c_script: C# ----------
    A = pl.Count;

    double[] pos = new double[pl.Count * 2];

    for(int i = 0 ; i < pl.Count; ++i) {
      int index = i * 2;
      pos[index] = pl[i].X;
      pos[index + 1] = pl[i].Y;
    }
    A = pos;
    
    string thePos = "";
    for(int i = 0 ; i < pos.Length; ++i) {
      thePos += pos[i].ToString() + ",";
    }
    
    
    B = thePos.Remove(thePos.Length - 1, 1);
# ---------- end c_script ----------
# https://namjulee.github.io/Data-Design-AI-for-Urban-Data-and-Viz-Harvard-GSD-public/lab/3d%20viz%20for%20gis/three-mesh-rhino-geo
# # **Data in Design, AI for Urban Data and Visualization**
# 
# #### Data, Design Computation, Artificial Intelligence, Visualization, Harvard GSD
# 
# 
# **KEYWORD:**
# Vector, Raster, Urban Data, GIS, Data Processing, Data Mining, Machine Learning, Artificial Intelligence, Visualization, Mapping, Design Decision-Making
# 
# -----
# 
# #### Instructor : NJ Namju Lee / nj.namju@gmail.com
# ###### * Linkedin - https://www.linkedin.com/in/nj-namju-lee-926b3252/    * Git - https://github.com/NamjuLee
# 
# ###### * Web - http://www.njstudio.co.kr                                  * Lab - http://www.njslab.com/NJSLabCore/
# 
# ###### * Video(English) - https://www.youtube.com/c/njnamjulee            * Writing(English) - https://medium.com/@nj-namju
# 
# ###### * Video(Korean) - https://www.youtube.com/c/CodeforDesign          * Writing(Korean) - https://brunch.co.kr/@njnamju
# -----
panel = Panel(c_script.A)
panel_2 = Panel(c_script.B)
