# Grasshopper definition LAB_03_Mesh.gh (Grasshopper 1.0.7)
# plug-ins: NumericalGeoUtilsForGH

# ----
# Mesh to JSON
# https://namjulee.github.io/Data-Design-AI-for-Urban-Data-and-Viz-Harvard-GSD-public/lab/3d%20viz%20for%20gis/three-mesh-rhino-geo
geo = Geometry(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)
geo_2 = Geometry(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)
brep = Brep([geo_2, geo])
mesh = Mesh(brep)
c_script = CSharpScript(m=mesh)  # -> out, A, B; inputs m: Mesh, id: String
# ---------- c_script: C# usings ----------
using System.IO;
using System.Linq;
using System.Data;
using System.Drawing;
using System.Reflection;
using System.Windows.Forms;
using System.Xml;
using System.Xml.Linq;
using System.Runtime.InteropServices;

using Rhino.DocObjects;
using Rhino.Collections;
using GH_IO;
using GH_IO.Serialization;
# ---------- c_script: C# ----------
    A = JsonTextFromMeshForTHREEJS(m, id);
# ---------- c_script: C# additional code ----------
  public static string JsonTextFromMeshForTHREEJS(Mesh m, string guid)
  {
    m.Faces.ConvertQuadsToTriangles();
    m.FaceNormals.ComputeFaceNormals();
    m.Normals.ComputeNormals();

    System.Text.StringBuilder w = new System.Text.StringBuilder();

    Point3d cp = GetCenterPtFromMesh(m);
    // string w = "";
    w.Append("{ \n  \"metadata\": [ \n");
    w.Append("{\"guid\":\"");
    w.Append(guid);
    w.Append("\"},\n");
    w.Append("{\"name\":\"");
    w.Append("\"},\n");
    w.Append("{\"version\": 4}, \n {\"type\": \"geometry\"}, \n {\"generator\": \"GeometryExporter\"} \n ]");

    w.Append(",\n \"center\": [" + cp.X + "," + cp.Y + "," + cp.Z + "], \n  \"v\" : [ \n");
    //string data = "TempVBOdata=new Float32Array([\n";
    for (int i = 0; i < m.Vertices.Count; ++i)
    {
      w.Append("[");
      w.Append(m.Vertices[i].X.ToString() + "," + m.Vertices[i].Y.ToString() + "," + m.Vertices[i].Z.ToString());
      w.Append("]");
      if (i == m.Vertices.Count - 1)
      {
        w.Append("");
      }
      else
      {
        w.Append(",");
      }
    }
    w.Append("\n ] \n , \n \"f\" : [ \n");
    int index = 0;
    foreach (MeshFace mf in m.Faces)
    {
      if (mf.IsQuad)
      {
        w.Append("[");
        w.Append(mf.A.ToString() + "," + mf.B.ToString() + "," + mf.C.ToString() + "," + mf.D.ToString());
        w.Append("]");
      }
      if (mf.IsTriangle)
      {
        w.Append("[");
        w.Append(mf.A.ToString() + "," + mf.B.ToString() + "," + mf.C.ToString());
        w.Append("]");
      }
      if (index == m.Faces.Count - 1)
      {
        w.Append("");
      }
      else
      {
        w.Append(",");
      }
      index++;
    }
    w.Append("\n ] \n }");
    return w.ToString();
  }


  static public Point3d GetCenterPtFromMesh(Mesh m){
    Point3d cp = new Point3d(0, 0, 0);
    foreach(Point3d p in m.Vertices){
      cp += p;
    }
    cp /= m.Vertices.Count;
    return cp;
  }
# ---------- end c_script ----------

geo_3 = Geometry(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)
geo_4 = Geometry(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)
brep_2 = Brep([geo_3, geo_4])
mesh_2 = Mesh(brep_2)
mjoin = MeshJoin(Meshes=mesh_2)
c_script_2 = CSharpScript(m=mjoin)  # -> out, A, B; inputs m: Mesh
# ---------- c_script_2: C# ----------
    A = JsonTextFromMeshForTHREEJS(m);
# ---------- c_script_2: C# additional code ----------
  public static string JsonTextFromMeshForTHREEJS(Mesh m, string guid = "null")
  {
    m.Faces.ConvertQuadsToTriangles();
    m.FaceNormals.ComputeFaceNormals();
    m.Normals.ComputeNormals();

    System.Text.StringBuilder w = new System.Text.StringBuilder();

    Point3d cp = GetCenterPtFromMesh(m);
    // string w = "";
    w.Append("{ \n  \"metadata\": [ \n");
    w.Append("{\"guid\":\"");
    w.Append(guid);
    w.Append("\"},\n");
    w.Append("{\"name\":\"");
    w.Append("\"},\n");
    w.Append("{\"version\": 4}, \n {\"type\": \"geometry\"}, \n {\"generator\": \"GeometryExporter\"} \n ]");

    w.Append(",\n \"center\": [" + cp.X + "," + cp.Y + "," + cp.Z + "], \n  \"v\" : [ \n");
    //string data = "TempVBOdata=new Float32Array([\n";
    for (int i = 0; i < m.Vertices.Count; ++i)
    {
      w.Append("[");
      w.Append(m.Vertices[i].X.ToString() + "," + m.Vertices[i].Y.ToString() + "," + m.Vertices[i].Z.ToString());
      w.Append("]");
      if (i == m.Vertices.Count - 1)
      {
        w.Append("");
      }
      else
      {
        w.Append(",");
      }
    }
    w.Append("\n ] \n , \n \"f\" : [ \n");
    int index = 0;
    foreach (MeshFace mf in m.Faces)
    {
      if (mf.IsQuad)
      {
        w.Append("[");
        w.Append(mf.A.ToString() + "," + mf.B.ToString() + "," + mf.C.ToString() + "," + mf.D.ToString());
        w.Append("]");
      }
      if (mf.IsTriangle)
      {
        w.Append("[");
        w.Append(mf.A.ToString() + "," + mf.B.ToString() + "," + mf.C.ToString());
        w.Append("]");
      }
      if (index == m.Faces.Count - 1)
      {
        w.Append("");
      }
      else
      {
        w.Append(",");
      }
      index++;
    }
    w.Append("\n ] \n }");
    return w.ToString();
  }


  static public Point3d GetCenterPtFromMesh(Mesh m){
    Point3d cp = new Point3d(0, 0, 0);
    foreach(Point3d p in m.Vertices){
      cp += p;
    }
    cp /= m.Vertices.Count;
    return cp;
  }
# ---------- end c_script_2 ----------

brep_3 = Brep([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])
sunion = SolidUnion(Breps=brep_3)
mesh_3 = Mesh(sunion)
io_json_for_three_js = IOJsonTHREEJS(Curves=mesh_3, BoolForFlip=False, StringForFilePath="C:\Users\namju\Desktop\", StringForFileName="mesh")

panel = Panel(c_script_2.A)
panel_2 = Panel(c_script.A)
panel_3 = Panel(io_json_for_three_js)
